test file "EquivaleceCaseTestFiles"
  description: #DC
  tags: #DC, 1, khsjfdh
  setup callback:
    disp('right tc pre load-Simulation 1');
    disp('Designs cloud Tests');
    disp('You can use the Test Manager to create test cases for Simulink® models and code in desktop, SIL, PIL, and HIL (for target computers running Simulink Real-Time™) execution environments. You can create or import test data, run tests, view results, and create reports. You can also import and test C and C++ code, and MATLAB® test scripts. ')

    disp('Designs cloud Tests');
    disp('Designs cloud Tests');
    disp('Designs cloud Tests');
    disp('Designs cloud Tests');
    disp('Designs cloud Tests');
    disp('Designs cloud Tests');
  cleanup callback:
    disp('right tc pre load-Simulation 1');
    disp('Designs cloud Tests');
    disp('You can use the Test Manager to code in desktop, SIL, PIL, and HIL (for target computers running Simulink Real-Time™) execution environments. You can create or import test data, run tests, view results, and create reports. You can also import and test C and C++ code, and MATLAB® test scripts. ')
    disp('Designs cloud Tests');
    disp('Designs cloud Tests');
    disp('Designs cloud Tests');
  coverage: Decision, MCDC, SignalRange, SimulinkDesignVerifier, RelationalBoundary, Condition, LookupTable, SignalSize, SaturationOnIntOverflow

suite "Test Suite For Design Cloud"

  case "Equivalence Test Case" [equivalence]
    description: left Equivalence  test case
    tags: baseline, testcase, Equivalence
    test data file: mCruise_control_sldvdataTheirs.xlsx
    simulation 1:
      model mAllIterationOptionsTheirs, harness mAllIterationOptionsTheirs_Harness2 (for mAllIterationOptionsTheirs/Subsystem), mode Normal, start time 5, stop time 100, initial state true
      configuration set: Configuration1
      parameter set "Parameter Set 1" (off): b = 3.1412  % model workspace
      parameter set "dInputs_LaunchData2.mat" (off): ts1 = 1x1 timeseries, ts2 = 1x1 timeseries
      parameter set "dBaseline_RightTest.mat" (off): data = 1x1 Simulink.SimulationData.Dataset
      parameter set "dBaseline_RightTest_Theirs.mat": data = 1x1 Simulink.SimulationData.Dataset
      input "dBaseline_RightTest_Theirs.mat"
      input "dInputs_LaunchData2.mat"
      input "dBaseline_RightTest.mat"
      input "Test case_1" from mCruise_control_sldvdataMine.xlsx
      input "Test case_2" from mCruise_control_sldvdataMine.xlsx
      input "Test case_3" from mCruise_control_sldvdataMine.xlsx
      input "Test case_1 (1)" from mCruise_control_sldvdataTheirs.xlsx, sheet Test case_1
      input "Test case_2 (1)" from mCruise_control_sldvdataTheirs.xlsx, sheet Test case_2
      input "Test case_3 (1)" from mCruise_control_sldvdataTheirs.xlsx, sheet Test case_3
      input "Test case_1 (2)" from mCruise_control_sldvdataMine.xlsx, sheet Test case_1
      input "Test case_2 (2)" from mCruise_control_sldvdataMine.xlsx, sheet Test case_2
      input "Test case_3 (2)" from mCruise_control_sldvdataMine.xlsx, sheet Test case_3
      input "dInputs_LaunchData2.mat (1)" from dInputs_LaunchData2.mat (active)
      logged signals "Signal Set 1" (off): Output Conversion Subsystem:1, Input Conversion Subsystem:1, In1:1, Output Conversion Subsystem:1
      logged signals "Signal Set 2" (off): In1:1
      logged signals "Signal Set 3" (off): Input Conversion Subsystem:1
      logged signals "Signal Set 4": Subsystem:1, Output Conversion Subsystem:1
      start logging when A == true
      stop logging after 600 s
      pre-load callback:
        disp('right tc pre load-Simulation 1');
        disp('Designs cloud Tests');
        disp('You can use the Test Manager to create test cases for Simulink® models and code in desktop, SIL, PIL, and HIL (for target computers running Simulink Real-Time™) execution environments. You can create or import test data, run tests, view results, and create reports. You can also import and test C and C++ code, and MATLAB® test scripts. ')
        disp('Designs cloud Tests');
        disp('Designs cloud Tests');
        disp('Designs cloud Tests');
        disp('Designs cloud Tests');
        disp('Designs cloud Tests');
        disp('Designs cloud Tests');
        disp('Designs cloud Tests');
        disp('Designs cloud Tests');
        disp('Designs cloud Tests');
        disp('Designs cloud Tests');
        disp('Designs cloud Tests');
        disp('Designs cloud Tests');
        disp('Designs cloud Tests');
        disp('Designs cloud Tests');
      post-load callback: same code as in pre-load callback of case "Equivalence Test Case"
      cleanup callback: same code as in pre-load callback of case "Equivalence Test Case"
    simulation 2:
      model mAllIterationOptions, harness mAllIterationOptions_Harness1 (for mAllIterationOptions/Subsystem), mode Rapid Accelerator
      parameter set "Parameter Set 2": a = 9.8  % model workspace
      input "dInputs_LaunchData2.mat" (active)
      logged signals "Signal Set 2": Gain:1
      pre-load callback:
        disp('right tc post load-Simulation 2');
      post-load callback:
        disp('right tc pre load-Simulation 2');
      cleanup callback:
        disp('right tc cleanup-Simulation 2');
    equivalence criteria
      Out1
    custom criteria:
      test.verifyTrue(true);
      disp('right tc pre load-Simulation 1');
      disp('Designs cloud Tests');
      disp('You can use the Test Manager to create test cases for Simulink® models and code in desktop, SIL, PIL, and HIL (for target computers running Simulink Real-Time™) execution environments. You can create or import test data, run tests, view results, and create reports. You can also import and test C and C++ code, and MATLAB® test scripts. ')
      disp('Designs cloud Tests');
      disp('Designs cloud Tests');
      disp('Designs cloud Tests');
      disp('Designs cloud Tests');
      disp('Designs cloud Tests');
      disp('Designs cloud Tests');
      disp('Designs cloud Tests');
      disp('Designs cloud Tests');
      disp('Designs cloud Tests');
      disp('Designs cloud Tests');
      disp('Designs cloud Tests');
      disp('Designs cloud Tests');
      disp('Designs cloud Tests');
      disp('Designs cloud Tests');
    assessment callback:
      A=100;
      disp('right tc pre load-Simulation 1');
      disp('Designs cloud Tests');
      disp('You can use the Test Manager to create test cases for Simulink® models and code in desktop, SIL, PIL, and HIL (for target computers running Simulink Real-Time™) execution environments. You can create or import test data, run tests, view results, and create reports. You can also import and test C and C++ code, and MATLAB® test scripts. ')
      disp('Designs cloud Tests');
      disp('Designs cloud Tests');
      disp('Designs cloud Tests');
      disp('Designs cloud Tests');
      disp('Designs cloud Tests');
      disp('Designs cloud Tests');
      disp('Designs cloud Tests');
      disp('Designs cloud Tests');
      disp('Designs cloud Tests');
      disp('Designs cloud Tests');
      disp('Designs cloud Tests');
      disp('Designs cloud Tests');
      disp('Designs cloud Tests');
      disp('Designs cloud Tests');
    assessment "Assessment7": At any point of time, D must be less than C or greater than B
    assessment "Assessment8": At any point of time, E must be greater than F and less than G
      B: not mapped
      C: not mapped
      D: not mapped
      E: not mapped
      F: not mapped
      G: not mapped
    iteration script:
      testItr = sltestiteration();
      disp('right tc pre load-Simulation 1');
      disp('Designs cloud Tests');
      disp('You can use the Test Manager to create test cases for Simulink® models and code in desktop, SIL, PIL, and HIL (for target computers running Simulink Real-Time™) execution environments. You can create or import test data, run tests, view results, and create reports. You can also import and test C and C++ code, and MATLAB® test scripts. ')
      disp('Designs cloud Tests');


      disp('Designs cloud Tests');
      disp('Designs cloud Tests');
      disp('Designs cloud Tests');
      disp('Designs cloud Tests');
      %% Iterate over all Parameter Sets.

      % Determine the number of possible iterations
      numSteps = length(sltest_parameterSets{1});

      % Create each iteration
      for k = 1 : numSteps
          % Set up a new iteration object
          testItr = sltestiteration();

          % Set iteration settings
          setTestParam(testItr, 'ParameterSet', sltest_parameterSets{1}{k}, 'SimulationIndex', 1);

          % Register the iteration to run in this test case
          addIteration(sltest_testCase, testItr); % You can pass in an optional iteration name
      end

  case "Real-Time Load From Model Case" [real-time]
    description: 1. Check Load Application is Model
      2. Check if the Target Computer names are rendered
      3. stop time
    model libModel, stop time 10, target computer PIC 8051

  case "Real-Time Load From Target Application Case" [real-time]
    description: 1. Check Load Application is Model
      2. Check if the Target Computer names are rendered
      3.Target Application Field
      3. stop time
    model libModel, stop time 10, target computer PIC 8051, application TargetApplication.exe

  case "Real-Time Load From Target Computer Case" [real-time]
    description: 1. Check Load Application is Model
      2. Check if the Target Computer names are rendered
      3. stop time
    model libModel, stop time 10, target computer PIC 8051

  case "Simulation Test Case" [simulation]
    description: sgfjdhf
    tags: sgjsdgfjh
    model /home/neham/Downloads/mldatx/mCruise_control_sldvdataTheirs.xlsx, mode Processor-in-the-Loop (PIL), start time 0, stop time 10, initial state 1

  case "Baseline Test Case" [baseline]
    description: Test Baselne test case with test data.
    tags: TestCase, BaselineTest, SimulationTest, RealTimeTest
    test data file: mCruise_control_sldvdataMine.xlsx
    model mAllIterationOptions, start time 10, stop time 100, initial state 1
    configuration set: TestVariable from dBaseline_RightTest.mat
    parameter set "tSubMergeCallback.m": ans = 1x1 tSubMergeCallback
    logged signals "Signal Set 1" (off): Signal Builder:1, In2:1, Gain1:1
    logged signals "Signal Set 2": Signal Builder:1, In1:1, Sum:1, Gain:1
    start logging when X>1000
    stop logging after 10000 s
    pre-load callback: same code as in pre-load callback of case "Equivalence Test Case"
    post-load callback: same code as in pre-load callback of case "Equivalence Test Case"
    cleanup callback: same code as in pre-load callback of case "Equivalence Test Case"
    baseline "dInputs_LaunchData2.mat"
      LaunchData
      LaunchData
    baseline "dBaseline_RightTest.mat"
      Out1:1
      Out2:1
    baseline "dBaseline_RightTest_Theirs.mat"
      Out1:1
      Out2:1
    baseline "dInputs_LaunchData2.mat (1)"
      LaunchData
      LaunchData
    baseline "dBaseline_RightTest.mat (1)"
      Out1:1
      Out2:1
    baseline "dInputs_LaunchData2.mat (2)"
      LaunchData
      LaunchData
    baseline "dBaseline_RightTest.mat (2)"
      Out1:1
      Out2:1
    baseline "dBaseline_RightTest.mat (3)"
      Out1:1
      Out2:1
    custom criteria:
      disp('right tc pre load-Simulation 1');
      disp('Designs cloud Tests');
      disp('You can use the Test Manager to create test cases for Simulink® models and code in desktop, SIL, PIL, and HIL (for target computers running Simulink Real-Time™) execution environments. You can create or import test data, run tests, view results, and create reports. You can also import and test C and C++ code, and MATLAB® test scripts. ')
      disp('Designs cloud Tests');
      disp('Designs cloud Tests');
      disp('Designs cloud Tests');
      disp('Designs cloud Tests');
    assessment callback: same code as in pre-load callback of case "Equivalence Test Case"
    assessment "Assessment1": At any point of time, if X>1000 becomes true then, with a delay of at most 1000, 1000 must stay true for at least 1000
    assessment "Assessment3": At any point of time, 1234 must be true
      X: not mapped
    iteration script:
      disp('right tc pre load-Simulation 1');
      disp('Designs cloud Tests');
      disp('You can use the Test Manager to create test cases for Simulink® models and code in desktop, SIL, PIL, and HIL (for target computers running Simulink Real-Time™) execution environments. You can create or import test data, run tests, view results, and create reports. You can also import and test C and C++ code, and MATLAB® test scripts. ')

      disp('Designs cloud Tests');
      disp('Designs cloud Tests');
      disp('Designs cloud Tests');

suite "Default Test Suit For Design Cloud"

  case "Baseline Test Case" [baseline]
    test data file: hgjhkjl
    model rytrfhghgj
    pre-load callback:
      fgjhbmbn
      s ajdj
      hscjkhx
    post-load callback:
      fgjhbmbn
      s ajdj
      hscjkhx
    cleanup callback:
      fgjhbmbn
      s ajdj
      hscjkhx

  case "Equivalence Test Case" [equivalence]
    description: @DC
    tags: zsf
    simulation 1:
      model ZSFDXBVMNCX

  case "Simulation Test Case" [simulation]

  case "Real-Time Test Case (Simulation Test)" [real-time]

  case "Real-Time Test Case (Baseline Test)" [real-time]

  case "Real-Time Test Case (Equivalence-Simulation 1 Test)" [real-time]

  case "Real-Time Test Case (Equivalence Test)" [real-time]

  case "Road Runner Test Case"
    RoadRunner: RunInConsoleMode: true; TurnOffPacing: true