test file "SLRT"
  description: description 1.0
  tags: tag1, tag2, tag3

suite "SLRT"

  case "Real-Time (Baseline Test)" [real-time]
    description: baseline test case SLRT modified
    tags: baseline, testcase, tag
    model mAllIterationOptions, target computer TargetPC2, application app1
    input "dInputs_LaunchData2.mat" (active)
    start logging when A==100
    stop logging after 2000 s
    pre-load callback:
      Line 1 Deleted
      2,3,4 added
    pre-start callback:
      sdgfjsd
    cleanup callback:
      disp('right tc cleanup'); dsdsdfgh
      name
    baseline "dBaseline_RightTest.mat"
      Out1:1
    custom criteria:
      B=100;
    assessment callback:
      a = 190;
    iterations:
      Iteration1: ExternalInput "dBaseline_RightTest.mat"
    iteration script:
      testItr = sltestiteration();

  case "Baseline Test v1" [baseline]
    description: deleted or modified?
    tags: TAG1, TAG2, tag, modified
    post-load callback:
      adasdsfrgr