test file "dTest_SLRT_FromModelTheirs"

suite "New Test Suite 1"

  case "New Test Case 1" [real-time]
    description: rightbaseline test case
    tags: baseline, testcase, right
    simulation 1:
      model mAllIterationOptions, harness mAllIterationOptions_Harness1 (for mAllIterationOptions/Subsystem), stop time 10, target computer TargetPC2
      input "dInputs_LaunchData2.mat" (active)
      start logging when A==100
      stop logging after 400 s
      pre-load callback:
        disp('right tc pre load');
      post-load callback:
        disp('post load from model');
      pre-start callback:
        disp('pre app from model');
      cleanup callback:
        disp('right tc cleanup');
    simulation 2:
      model mAllIterationOptions, harness mAllIterationOptions_Harness1 (for mAllIterationOptions/Subsystem), mode Processor-in-the-Loop (PIL), start time 5, stop time 100, initial state true
      configuration set: B=100 from mCruise_control_sldvdata.xlsx
      signal scenario: Group 2 (mAllIterationOptions/Signal Builder)
      input "dInputs_LaunchData2.mat" (active)
      logged signals "Signal Set 1": Subsystem:1
      start logging when A==100
      pre-load callback:
        disp('right tc pre load-Simulation 2');
      post-load callback:
        disp('post load from model-Simulation 2');
      cleanup callback:
        disp('right tc cleanup-Simulation 2');
    custom criteria:
      B=100;
    assessment callback:
      a=190;
    iterations:
      Iteration1
    iteration script:
      testItr = sltestiteration();