test file "SLRT"
  description: description 1.0
  tags: tag1, tag2, tag3

suite "SLRT"

  case "Baseline Test" [baseline]
    description: deleted or modified?
    tags: TAG1, TAG2, tag, modified
    post-load callback:
      adasdsfrgr

  case "slrt" [real-time]
    description: SFCBSDMJVC
      DSFHDSKHDSF
      SFHKJDSHFL
      SFHDSKJHF
    stop time 10
    pre-load callback:
      % Create each iteration
      for k = 1 : numSteps
          % Set up a new iteration object
          testItr = sltestiteration();

          % Set iteration settings
          setTestParam(testItr, 'ParameterSet', sltest_parameterSets{1}{k}, 'SimulationIndex', 1);

          % Register the iteration to run in this test case
          addIteration(sltest_testCase, testItr); % You can pass in an optional iteration name
      end
    post-load callback:
      DSFHDSKHDSF
      SFHKJDSHFL
      SFHDSKJHF
    pre-start callback:
      DSFHDSKHDSF
      SFHKJDSHFL
      SFHDSKJHF
    cleanup callback:
      DSFHDSKHDSF
      SFHKJDSHFL
      SFHDSKJHF
    custom criteria: same code as in pre-load callback of case "slrt"