test file "TestManagerFile"
  coverage: Decision

suite "SLRT"
  setup callback:
    % Create each iteration
    for k = 1 : numSteps
        % Set up a new iteration object
        testItr = sltestiteration();

        % Set iteration settings
        setTestParam(testItr, 'ParameterSet', sltest_parameterSets{1}{k}, 'SimulationIndex', 1);

        % Register the iteration to run in this test case
        addIteration(sltest_testCase, testItr); % You can pass in an optional iteration name
    end

  case "Real-Time (Baseline Test)" [real-time]
    description: baseline test case SLRT
    tags: baseline, testcase, reft
    model mAllIterationOptions, target computer TargetPC2, application app1
    input "dInputs_LaunchData2.mat" (active)
    start logging when A==100
    stop logging after 2000 s
    pre-load callback:
      disp('right tc pre load');
    pre-start callback:
      disp('pre app from application');
    cleanup callback:
      disp('right tc cleanup');
    baseline "dBaseline_RightTest.mat"
      Out1:1
      Out2:1
    custom criteria:
      B=100;
    assessment callback:
      a = 190;
    iterations:
      Iteration1: ExternalInput "dBaseline_RightTest.mat"
    iteration script:
      testItr = sltestiteration();

  case "Baseline Test" [baseline]
    description: Add Description here-----
    tags: TAG1, TAG2
    pre-load callback:
      sjdfgjdsgfkdskwdsjdoi cSUDIHSKCSKNCKDSncknvcdjf hkdjbvfdkvfdvfdvzhdsikvjnkdnvcdbvhfdvgiudsfjvclmdsvndkj

  suite "TestSuite"

    case "Equivalence" [equivalence]