test file "dTest_SLRT_FromApplicationMine"

suite "SLRT"

  case "TestCase" [real-time]
    description: rightbaseline test case
    tags: baseline, testcase, right
    model mAllIterationOptions, target computer TargetPC2, application app1
    input "dInputs_LaunchData2.mat" (active)
    start logging when A==100
    stop logging after 2000 s
    pre-load callback:
      disp('right tc pre load');
    pre-start callback:
      disp('pre app from application');
    cleanup callback:
      disp('right tc cleanup');
    baseline "dBaseline_RightTest.mat"
      Out1:1
      Out2:1
    custom criteria:
      B=100;
    assessment callback:
      a = 190;
    iterations:
      Iteration1: ExternalInput "dBaseline_RightTest.mat"
    iteration script:
      testItr = sltestiteration();

  suite "TestSuite"

    case "Baseline" [baseline]